vi "Spectrum Monitor.gvi"   [LabVIEW Communications System Design Software 2.0.1]
outputs:
  "LO Frequency": f64
  "Spectrum Size": i32
  "Frame Parameters Out": T5
panel controls:
  "RX Parameters In": T1 = {"IQ Sampling Rate [S/sec]"=20000000, "Gain [dB]"=0, "Reference Frequency"="", "Timebase Clock Source"="", "Start Carrier [Hz]"=50000000, "Stop Carrier [Hz]"=500000000, "Acq Duration [sec]"=0.0001, "Active Antenna"=""}
  "Device Names": "niUSRPClass"
  "Averaging Parameters": "Averaging Parameters.gtype" = {"averaging mode"="No averaging", "weighting mode"="Exponential", "number of averages"=10}  # averaging parameters defines how the averaging is computed. The specifications of the parameters include the type of averaging, the type of weighting, and the number of averages.
  "Display": T4 = {"display unit"="Vrms", "dB type"="dB"}
  "Stop Capture": bool
  "Tab": i32
  "threshold": f64
  "IQ frac": enum{"0.25", "0.5", "0.6", "0.8"} = "0.25"
panel indicators:
  "error out": error
  "Samples per Acquisition": i64
  "Carrier Freq Out": f64
  "FFT Power Spectrum": cluster{"f0": f64, "df": f64, "IQ": f64[]}
  "Carrier List": f64[]
  "Power Detection": "Power Detection cluster.gtype"
  "2D(freq,ind)": f64[][]
  "signals2D": f64[][]
  "df": f64
  "Trigger Save?": bool
  "f0": f64[]
types:
  T1 = cluster{"IQ Sampling Rate [S/sec]": f64, "Gain [dB]": f64, "Reference Frequency": string, "Timebase Clock Source": string, "Start Carrier [Hz]": f64, "Stop Carrier [Hz]": f64, "Acq Duration [sec]": f64, "Active Antenna": string}
  T2 = enum{"No averaging", "Vector averaging", "RMS averaging", "Peak hold"}
  "Averaging Parameters.gtype" = cluster{"averaging mode": T2, "weighting mode": enum{"Linear", "Exponential"}, "number of averages": u32}
  T3 = enum{"Vrms", "Vpk", "Vrms^2", "Vpk^2", "Vrms/rtHz", "Vpk/rtHz", "Vrms^2/Hz", "Vpk^2/Hz"}
  T4 = cluster{"display unit": T3, "dB type": enum{"Linear", "dB", "dBm"}}
  T5 = cluster{"IQ Rate": f64, "Frames": i32, "Length of Subset": i32, "Start Carrier [Hz": f64, "Stop Carrier [Hz]": f64, "Acq Duration [Sec]": f64, "Start Index of Subset": i32}
  "Power Detection cluster.gtype" = cluster{"Estimated Freqs. above Threshold": f64[], "Power at those Freqs.": f64[], "Num. peaks detected": i32, "Num. in queue": i32}
diagram:
  call "niUSRP Open Rx Session.gvi"(niUSRP Device=$"Device Names") -> (error out=w1, session handle out=w2)
  call "Set Parameters.gvi"(RX Parameters In=$"RX Parameters In", USRP Session Handle In=w2, error in (no error)=w1, IQ frac=$"IQ frac") -> (error out: HW RX Param subsetup=w3, USRP Session Handle Out=w4, Test Carrier Frequencies=w5, Samples per Acquisition=w6, Frame Parameters Out=w7, IQ frac out=w8)
  Property Node(instance in=$"Averaging Parameters") -> ("number of averages"=w9, instance out=w10)
  call "niUSRP Configure Number of Samples.gvi"(session handle=w4, number of samples is finite=TRUE, number of samples=w6, error in (no error)=w3) -> (session handle out=w11, Error Out=w12)
  To Long Integer(number=w9) -> w13
  w14 = $Display
  w15 = $threshold
  # Testing Spectrum Monitor. Not as many indicators will
  # be on panel in final version.
  s1 = uninitialised  # shift register
  while {
    Is First Call() -> w16
    # Go back to the first carrier frequency and repeat
    s2 = 0  # shift register
    for (iteration -> i1) {
      w17 = each element of w5
      call "Set Carrier and LO_2.gvi"(Current Frequency=w17, niusrp in_2=w11, error in=w12) -> (Error=w18, Usrp.niUSRPClass=w19)
      call "Array Indices for Sub-band.gvi"(First call=w16, error in=w18, 2D(freq,ind)=s1, niusrp in=w19, IQ frac=w8) -> (Local Interests=w20, error out=w21, Usrp.niUSRPClass out=w22)
      # Get new carrier frequency
      for (N = w13) (iteration -> i2) {
        # Averaging Loop
        call "Read Data.gvi"(USRP Session Handle In=w22, error in=w21, Number of Samples=w6) -> (USRP Session Handle Out=w24, error out=w25, data=w26)
        Is Equal To 0(x=i2) -> w27
        call "Establish Sub-band.gvi"(Restart Averaging=w27, Frame Parameters=w7, Averaging Parameters=w10, error in=w25, Input Baseband IQ=w26) -> (Power Spectrum averaged Subset=w28, Window Properties=w29, error out=w30, Frame Parameters Out=w31, power spectrum current=w32)
        call "Gather Signals for Saving.gvi"(Local Interests=w20, power spectrum current=w32, Window Properties=w29) -> (f0=w33, signals2D=w34, Trigger Save?=w35, df=w36)
        # w27: First Rx for this carrier?
        Logical Or(w30, $"Stop Capture") -> w37
        append w30 to w23
        stop if w37
      }
      Merge Errors(w23) -> (error out=w38)
      Property Node(instance in=w24, error in=w38) -> ("Carrier Frequency"=w39, "LO Frequency"=w40, error out=w41, instance out=w42)
      $"Carrier Freq Out" <- w39
      $signals2D <- w34
      $f0 <- w33
      $"LO Frequency" <- w40
      $df <- w36
      $"Trigger Save?" <- w35
      call "Aggregate Sub-band into Spectrum.gvi"(Frame Parameters=w31, Power Spectrum Subset=w28, Window Properties In=w29, Display=w14, Iteration=i1) -> (Spectrum to Plot=w43, Frame Parameters Out=w44, Spectrum Size=w45)
      call "Plot Spectrum.gvi"(Frame Parameters=w44, Spectrum to Plot In=w43) -> (Spectrum to Plot Out=w46, Frame Parameters out=w47)
      $"FFT Power Spectrum" <- w46
      $"Spectrum Size" <- w45
      next s2 = w40
      stop if w37
    }
    call "Signal Power Detection_2.gvi"(Power Spectrum=w46, threshold=w15, Frame Parameters=w47) -> (Power at those Freqs.=w48, Est. Freqs above Thresh=w49, count=w50, sub_band_ind=w51)
    call "Array Fill.gvi"(sub_band_ind=w51, Est. Freqs above Thresh=w49, Count=w50) -> (2D(freq,ind)=w52, number elements in array=w53)
    $"2D(freq,ind)" <- w52
    Build Cluster(w49, w48, w50, w53) -> w54
    $"Power Detection" <- w54
    next s1 = w52
    stop if w37
  }
  call "niUSRP Abort.gvi"(Handle in=w42, error in (no error)=w41) -> (Handle out=w55, Error Out=w56)
  call "niUSRP Close Session.gvi"(handle in=w55, error in=w56) -> (error out=w57)
  $"error out" <- w57
  $"Carrier List" <- w5
  $"Samples per Acquisition" <- w6
  $"Frame Parameters Out" <- w7
